# Grasshopper definition wordnet.gh (Grasshopper 1.0.7)
# plug-ins: wordnet

conceptnet = Conceptnet(Term1="dog", Term2="cat")  # -> ConceptRelations, RelatedTerms, TermsRelations, HowTermsRelated, RelationScore
wordnet = Wordnet(String1="car", String2="automobile")  # -> Synonym, PartOfSpeach, Gloss, Similarity
panel = Panel(conceptnet.TermsRelations)
panel_2 = Panel(conceptnet.ConceptRelations)
panel_3 = Panel(conceptnet.RelationScore)
panel_4 = Panel(wordnet.Similarity)
panel_5 = Panel(wordnet.Synonym)
panel_6 = Panel(wordnet.PartOfSpeach)
panel_7 = Panel(wordnet.Gloss)
